# Grasshopper definition test3.gh (Grasshopper 1.0.7)

gradient = Gradient(LowerLimit=0, UpperLimit=1, stops=[0: RGB(0, 128, 0), 0.5: RGB(255, 255, 0), 1: RGB(255, 0, 0)])
curve = Curve([<curve referenced from the Rhino model> x26])
vector = Vector()
send_data = GhPythonScript(x=curve)  # -> out, int, fp, flatten(cen), nodes, a; inputs x: list
# ---------- send_data: Python ----------
__author__ = "drago"
__version__ = "2020.06.01"

import rhinoscriptsyntax as rs
import webbrowser
import System.Net.WebRequest as req
import System.IO.StreamReader as reader
import System.IO.StreamWriter as writer
import json

nodes = []
edges = []
int = []
#####find floorplan lines and centroids
start = 2
for i in x:
    node = {"id":"","roomtype":"","floorArea":"","walls":[],"center":[]}
    points = []
    for j in rs.CurveEditPoints(i):
        points.append(list(j))
    node["id"] = start
    node["center"] = list(rs.CurveAreaCentroid(i)[0])
    node["walls"] =  points
    node["floorArea"] = rs.CurveArea(i)[0]
    nodes.append(node)
    start += 1
#####find intersections between curves
for c in range(0,len(x)-1):
    x1 = x[c::]
    edge = {"edgeId":"0/0","nodes":["1","1"],
        "isAccessible":False,"isDoorway":False,
        "adjWalls":[{"matId":[],"vertices":[],"thickness":[],"composition":[]}]}
    for k in range(0,len(x1)-1):
        intersect = rs.CurveCurveIntersection(x1[0],x1[k+1])
        if intersect != None:
            if intersect[0][0] == 2:
                int.append([list(intersect[0][1]),list(intersect[0][2])])

json_dict = {"nodes":nodes,"int":int}
a = json.dumps(json_dict)
try:
    httpreq = req.Create("http://localhost:5000/req/")
    httpreq.ContentType = "application/json"
    httpreq.Method = "POST"
    httpwrite = writer(httpreq.GetRequestStream())
    httpreq.Timeout = 1000
    httpwrite.Write(a)
    httpwrite.Close()
    httpresponse = httpreq.GetResponse()
    print(httpresponse)
except:
    pass

a = nodes[0]["walls"]

#print(a)
# ---------- end send_data ----------
receive_data = GhPythonScript(x=send_data.a, y=Toggle(False))  # -> out, doc_object, a; inputs x: list
# ---------- receive_data: Python ----------
__author__ = "drago"
__version__ = "2020.06.02"

import rhinoscriptsyntax as rs
import scriptcontext
import Rhino

if y:
    scriptcontext.doc = ghdoc
    x1 = x
    print(x1)
    c = rs.AddPolyline(x1)
    doc_object = rs.coercecurve(c)
    print(c)
    scriptcontext.doc = Rhino.RhinoDoc.ActiveDoc
    rhino_brep = scriptcontext.doc.Objects.Add(doc_object)
    
    #geometry = doc_object.Geometry
    
    #doc_object = rs.coercerhinoobject(c, True, True)
    
    #scriptcontext.doc = Rhino.RhinoDoc.ActiveDoc
    #rhino_brep = scriptcontext.doc.Objects.Add(geometry, attributes)
    #scriptcontext.doc = Rhino.RhinoDoc.ActiveDoc
    rs.ObjectLayer(rhino_brep, "Layer 02")
    scriptcontext.doc = ghdoc
# ---------- end receive_data ----------
panel = Panel(send_data.a)
panel_2 = Panel(send_data.nodes)
unit_z = UnitZ(Factor=1)
panel_3 = Panel(receive_data.doc_object)
extrude = Extrude(Direction=unit_z)
open_browser = BooleanToggle(False)
ghpython_script = GhPythonScript(y=open_browser)  # -> out, a
# ---------- ghpython_script: Python ----------
__author__ = "drago"
__version__ = "2020.06.23"

import rhinoscriptsyntax as rs
import webbrowser

if y:
    url = "http://localhost:5000/"
    #MacOS
    #chrome_path = 'open -a /Applications/Google\ Chrome.app %s'
    #windows
    chrome_path = 'C:/Program Files (x86)/Google/Chrome/Application/chrome.exe %s'
    # Linux
    # chrome_path = '/usr/bin/google-chrome %s'
    webbrowser.get(chrome_path).open(url)
# ---------- end ghpython_script ----------
