# Grasshopper definition test_data.gh (Grasshopper 1.0.7)

height = Slider(2.6, range=2.6..5)
levels = Slider(1, range=1..100)
timer = Timer(TimerInterval=5000, Target=sender)  # disabled
curve = Curve([<curve referenced from the Rhino model> x34])
sender = GhPythonScript(x=curve, y=Toggle(True))  # -> out, a; inputs x: list
# ---------- sender: Python ----------
__author__ = "drago"
__version__ = "2020.06.01"

import rhinoscriptsyntax as rs
import webbrowser
import System.Net.WebRequest as req
import System.IO.StreamReader as reader
import System.IO.StreamWriter as writer
import json

nodes = []
edges = []
int = []
#####find floorplan lines and centroids
start = 2
if y:
    for i in x:
        node = {"id":"","roomtype":"","floorArea":"","walls":[],"center":[]}
        points = []
        for j in rs.CurveEditPoints(i):
            points.append(list(j))
        node["id"] = start
        node["center"] = list(rs.CurveAreaCentroid(i)[0])
        node["walls"] =  points
        node["floorArea"] = rs.CurveArea(i)[0]
        nodes.append(node)
        start += 1
    #####find intersections between curves
    for c in range(0,len(x)-1):
        x1 = x[c::]
        edge = {"edgeId":"0/0","nodes":["1","1"],
            "isAccessible":False,"isDoorway":False,
            "adjWalls":[{"matId":[],"vertices":[],"thickness":[],"composition":[]}]}
        for k in range(0,len(x1)-1):
            intersect = rs.CurveCurveIntersection(x1[0],x1[k+1])
            if intersect != None:
                if intersect[0][0] == 2:
                    int.append([list(intersect[0][1]),list(intersect[0][2])])
    
    json_dict = {"nodes":nodes,"int":int}
    a = json.dumps(json_dict)
    try:
        httpreq = req.Create("http://localhost:5000/req/")
        httpreq.ContentType = "application/json"
        httpreq.Method = "POST"
        httpwrite = writer(httpreq.GetRequestStream())
        httpreq.Timeout = 1000
        httpwrite.Write(a)
        httpwrite.Close()
        httpresponse = httpreq.GetResponse()
        print(httpresponse)
    except:
        pass
    
    a = nodes[0]["walls"]
# ---------- end sender ----------
receiver = GhPythonScript(y=Toggle(False), levels=levels, height=height)  # -> out, a, output, c, fc
# ---------- receiver: Python ----------
__author__ = "drago"
__version__ = "2020.06.25"

import rhinoscriptsyntax as rs
import time
import json
import System.Net.WebClient as WebClient

if y:

    client = WebClient()
    content = client.DownloadString("http://localhost:5000/get/")
    output = json.loads(content)
    
    mat_array = output[0]
    mat_breakdown = {}
    for m in mat_array:
        mat_breakdown[m] = 0
    output = output[1]
    c = []
    gwp = []
    fc = []
    gwp_fc = []
        
    levels = int(levels)
        
    for i in range(0,len(output)):
        north_wall = output[i]["wall_N"]["vertices"]
        north_mat = output[i]["wall_N"]["material"]
        north_gwp = output[i]["wall_N"]["GWP"]
        for m in range(0,len(north_mat)):
            mat_breakdown[north_mat[m]] += north_gwp[m]
        for j in range(0,len(north_wall)):
            if north_wall[j][0]==north_wall[j][1]:
                pass
            else:
                start = north_wall[j][0]
                end = north_wall[j][1]
                for k in range(0,levels):
                    start[2] = k*height 
                    end[2] = k*height
                    c.append(rs.AddPolyline([start,end]))
                    gwp.append(north_gwp[j])
                
        south_wall = output[i]["wall_S"]["vertices"]
        south_mat = output[i]["wall_S"]["material"]
        south_gwp = output[i]["wall_S"]["GWP"]
        for m in range(0,len(south_mat)):
            mat_breakdown[south_mat[m]] += south_gwp[m]
        for j in range(0,len(south_wall)):
            if south_wall[j][0]==south_wall[j][1]:
                pass
            else:
                start = south_wall[j][0]
                end = south_wall[j][1]
                for k in range(0,levels):
                    start[2] = k*height 
                    end[2] = k*height
                    c.append(rs.AddPolyline([start,end]))
                    gwp.append(south_gwp[j])
                
        west_wall = output[i]["wall_W"]["vertices"]
        west_mat = output[i]["wall_W"]["material"]
        west_gwp = output[i]["wall_W"]["GWP"]
        for m in range(0,len(west_mat)):
            mat_breakdown[west_mat[m]] += west_gwp[m]
        for j in range(0,len(west_wall)):
            if west_wall[j][0]==west_wall[j][1]:
                pass
            else:
                start = west_wall[j][0]
                end = west_wall[j][1]
                for k in range(0,levels):
                    start[2] = k*height 
                    end[2] = k*height
                    c.append(rs.AddPolyline([start,end]))
                    gwp.append(west_gwp[j])
                    
        east_wall = output[i]["wall_E"]["vertices"]
        east_mat = output[i]["wall_E"]["material"]
        east_gwp = output[i]["wall_E"]["GWP"]
        for m in range(0,len(east_mat)):
            mat_breakdown[east_mat[m]] += east_gwp[m]
        for j in range(0,len(east_wall)):
            if east_wall[j][0]==east_wall[j][1]:
                pass
            else:
                start = east_wall[j][0]
                end = east_wall[j][1]
                for k in range(0,levels):
                    start[2] = k*height 
                    end[2] = k*height
                    c.append(rs.AddPolyline([start,end]))
                    gwp.append(east_gwp[j])
                    
                    
        for k in range(0,levels):
            floor = output[i]["walls"]
            for j in floor:
                j[2] = (k+1)*height
            fc.append(rs.AddPolyline(floor))
            gwp_fc.append(output[i]["floorGWP"])
            
        print(mat_breakdown)
# ---------- end receiver ----------
timer_2 = Timer(TimerInterval=5000, Target=receiver)  # disabled
unit_z = UnitZ(Factor=height)
extrude = Extrude(Base=receiver.c, Direction=unit_z)
