# Grasshopper definition test_data2.gh (Grasshopper 1.0.7)

# ---- group: Double click / Toggle "True"
boolean_toggle = BooleanToggle(True)

# ---- group: Double click
# INPUTS
# Building parameters
# Shoebox curve input
number_of_floors = Slider(4, range=0..100)
floor_to_floor_height_m = Slider(52, range=50..80, expression="x*0.05")
curve = Curve([<curve referenced from the Rhino model> x34])

# ---- group: Double click / Toggle "True"
boolean_toggle_2 = BooleanToggle(True)

# ---- group: Double click
timer = Timer(TimerInterval=5000, Target=sender)  # disabled
timer_2 = Timer(TimerInterval=5000, Target=receiver)  # disabled

# ---- group: Web-server input/output
sender = GhPythonScript(x=curve, y=boolean_toggle_2)  # -> out, a; inputs x: list
# ---------- sender: Python ----------
__author__ = "drago"
__version__ = "2020.06.01"

import rhinoscriptsyntax as rs
import webbrowser
import System.Net.WebRequest as req
import System.IO.StreamReader as reader
import System.IO.StreamWriter as writer
import json

nodes = []
edges = []
int = []
#####find floorplan lines and centroids
start = 2
if y:
    for i in x:
        node = {"id":"","roomtype":"","floorArea":"","walls":[],"center":[]}
        points = []
        for j in rs.CurveEditPoints(i):
            points.append(list(j))
        node["id"] = start
        node["center"] = list(rs.CurveAreaCentroid(i)[0])
        node["walls"] =  points
        node["floorArea"] = rs.CurveArea(i)[0]
        nodes.append(node)
        start += 1
    #####find intersections between curves
    for c in range(0,len(x)-1):
        x1 = x[c::]
        edge = {"edgeId":"0/0","nodes":["1","1"],
            "isAccessible":False,"isDoorway":False,
            "adjWalls":[{"matId":[],"vertices":[],"thickness":[],"composition":[]}]}
        for k in range(0,len(x1)-1):
            intersect = rs.CurveCurveIntersection(x1[0],x1[k+1])
            if intersect != None:
                if intersect[0][0] == 2:
                    int.append([list(intersect[0][1]),list(intersect[0][2])])
    
    json_dict = {"nodes":nodes,"int":int}
    a = json.dumps(json_dict)
    try:
        httpreq = req.Create("http://localhost:5000/req/")
        httpreq.ContentType = "application/json"
        httpreq.Method = "POST"
        httpwrite = writer(httpreq.GetRequestStream())
        httpreq.Timeout = 1000
        httpwrite.Write(a)
        httpwrite.Close()
        httpresponse = httpreq.GetResponse()
        print(httpresponse)
    except:
        pass
    
    a = nodes[0]["walls"]
# ---------- end sender ----------
receiver = GhPythonScript(y=boolean_toggle, levels=number_of_floors, height=floor_to_floor_height_m)  # -> c, fc, gwpfinal, gwpPerM2, normgwp, mat_values, mat_keys, mat_values_n
# ---------- receiver: Python ----------
__author__ = "drago"
__version__ = "2020.06.25"

import rhinoscriptsyntax as rs
import time
import json
import System.Net.WebClient as WebClient

if y:

    client = WebClient()
    content = client.DownloadString("http://localhost:5000/get/")
    output = json.loads(content)
    
    mat_array = output[0]
    mat_breakdown = {}
    for m in mat_array:
        mat_breakdown[m] = 0        #per floor
    output = output[1]
    c = []                          #wall curves
    gwp = []                        #
    fc = []
    gwp_fc = []                     #floor curves
    gwplocalm2 =[]                  #localized gwp/m2
    gwp_sum_floor = 0               #gwp sum per floor
    area_sum_floor = 0              #area sum per floor
    gwp_sum_area = 0
    levels = int(levels)
        
    for i in range(0,len(output)):
        area = output[i]["floorArea"]
        area_sum_floor += area
        
        north_wall = output[i]["wall_N"]["vertices"]
        north_mat = output[i]["wall_N"]["material"]
        north_gwp = output[i]["wall_N"]["GWP"]
        gwp_sum_floor += sum(north_gwp)
        for m in range(0,len(north_mat)):
            mat_breakdown[north_mat[m]] += north_gwp[m]
        for j in range(0,len(north_wall)):
            if north_wall[j][0]==north_wall[j][1]:
                pass
            else:
                gwplocalm2.append(north_gwp[j]/area)
                start = north_wall[j][0]
                end = north_wall[j][1]
                for k in range(0,levels):
                    start[2] = k*height 
                    end[2] = k*height
                    c.append(rs.AddPolyline([start,end]))
                    gwp.append(north_gwp[j]/area)
                
        south_wall = output[i]["wall_S"]["vertices"]
        south_mat = output[i]["wall_S"]["material"]
        south_gwp = output[i]["wall_S"]["GWP"]
        gwp_sum_floor += sum(south_gwp)
        for m in range(0,len(south_mat)):
            mat_breakdown[south_mat[m]] += south_gwp[m]
        for j in range(0,len(south_wall)):
            if south_wall[j][0]==south_wall[j][1]:
                pass
            else:
                gwplocalm2.append(south_gwp[j]/area)
                start = south_wall[j][0]
                end = south_wall[j][1]
                for k in range(0,levels):
                    start[2] = k*height 
                    end[2] = k*height
                    c.append(rs.AddPolyline([start,end]))
                    gwp.append(south_gwp[j]/area)
                
        west_wall = output[i]["wall_W"]["vertices"]
        west_mat = output[i]["wall_W"]["material"]
        west_gwp = output[i]["wall_W"]["GWP"]
        gwp_sum_floor += sum(west_gwp)
        for m in range(0,len(west_mat)):
            mat_breakdown[west_mat[m]] += west_gwp[m]
        for j in range(0,len(west_wall)):
            if west_wall[j][0]==west_wall[j][1]:
                pass
            else:
                gwplocalm2.append(west_gwp[j]/area)
                start = west_wall[j][0]
                end = west_wall[j][1]
                for k in range(0,levels):
                    start[2] = k*height 
                    end[2] = k*height
                    c.append(rs.AddPolyline([start,end]))
                    gwp.append(west_gwp[j]/area)
                    
        east_wall = output[i]["wall_E"]["vertices"]
        east_mat = output[i]["wall_E"]["material"]
        east_gwp = output[i]["wall_E"]["GWP"]
        gwp_sum_floor += sum(east_gwp)
        for m in range(0,len(east_mat)):
            mat_breakdown[east_mat[m]] += east_gwp[m]
        for j in range(0,len(east_wall)):
            if east_wall[j][0]==east_wall[j][1]:
                pass
            else:
                gwplocalm2.append(east_gwp[j]/area)
                start = east_wall[j][0]
                end = east_wall[j][1]
                for k in range(0,levels):
                    start[2] = k*height 
                    end[2] = k*height
                    c.append(rs.AddPolyline([start,end]))
                    gwp.append(east_gwp[j]/area)
                    
                    
        for k in range(0,levels):
            floor = output[i]["walls"]
            for j in floor:
                j[2] = (k+1)*height
            fc.append(rs.AddPolyline(floor))
            gwp_fc.append(output[i]["floorGWP"]/area)
            
print(mat_breakdown)

gwp_per_m2 = gwp+gwp_fc         ###localized gwp per m2

B=[]
normgwp=[]

#normalised GWP data 
#for a in range(0,len(gwp_per_m2)):
#    B.append(gwp_per_m2[a]+abs(min(gwp_per_m2)))

#for b in range(0,len(gwp_per_m2)):
#    eqn1=B[b]-min(B)
#    eqn2=max(B)-min(B)
#    eqn3=eqn1/eqn2
#    normgwp.append(eqn3)
    
min_gwpm2 = min(gwp_per_m2)
max_gwpm2 = max(gwp_per_m2)
normgwp = [(x-min_gwpm2)/(max_gwpm2-min_gwpm2) for x in gwp_per_m2]
gwpfinal = gwp_sum_floor*levels
gwpPerM2 = gwp_sum_floor/area_sum_floor

mat_keys = mat_breakdown.keys()
mat_keys = [str(mat_keys.index(x))+": "+str(x) for x in mat_keys]
mat_values = mat_breakdown.values()
mat_values_n = [(x-min(mat_values))/(max(mat_values)-min(mat_values)) for x in mat_values]
# ---------- end receiver ----------

# ----
unit_z = UnitZ(Factor=floor_to_floor_height_m)
extrude = Extrude(Base=receiver.c, Direction=unit_z)  # -> flatten(Extrusion)
partition_list = PartitionList(List=receiver.fc, Size=1)
patch = Patch(Curves=partition_list, Spans=20, Flexibility=1, Trim=True)  # -> flatten(Patch)

# ----
# OUTPUTS
gwp_per_floor_area_kgco2eq_m2 = Panel(receiver.gwpPerM2)
gradient = Gradient(
    LowerLimit=0,
    UpperLimit=1,
    Parameter=receiver.normgwp,
    stops=[0: RGBA(0, 128, 0, 120), 0.5: RGBA(255, 255, 0, 120), 1: RGBA(255, 0, 0, 120)])
custom_preview = CustomPreview(Geometry=[extrude, patch], Material=gradient)

total_gwp_kgco2eq_m2 = Panel(receiver.gwpfinal)
gradient_2 = Gradient(
    LowerLimit=0,
    UpperLimit=1,
    Parameter=receiver.mat_values_n,
    stops=[0: RGB(0, 128, 0), 0.5: RGB(255, 255, 0), 1: RGB(255, 0, 0)])
legend = Legend(Colour=gradient_2, Tags=receiver.mat_keys, LegendType=101)
material_gwp_in_building_kgco2eq_m2 = Panel(receiver.mat_values)
