# Grasshopper definition pluggy.gh (Grasshopper 1.0.7)

maxadjroomdist = Slider(0.5, range=0.01..1)
structural_walls = Curve([<curve referenced from the Rhino model> x14])
errormargin = Slider(0.1, range=0.001..1)
public_circulation = Curve(<curve referenced from the Rhino model>)
infill_walls = Curve([<curve referenced from the Rhino model> x53])
linestep = Slider(0.1, range=0.01..10)
living_rooms = Curve([<curve referenced from the Rhino model> x3])
bedrooms = Curve([<curve referenced from the Rhino model> x6])
boundary = Curve(<curve referenced from the Rhino model>)
wet_cells = Curve([<curve referenced from the Rhino model> x5])
storages = Curve([<curve referenced from the Rhino model> x3])
hallways = Curve([<curve referenced from the Rhino model> x3])
kitchen = Curve([<curve referenced from the Rhino model> x3])
others = Curve([<curve referenced from the Rhino model> x5])
deconstruct_brep = DeconstructBrep(Brep=boundary)  # -> Faces, Edges, Vertices
c_script = CSharpScript(
    lineStep=linestep,
    errorMargin=errormargin,
    maxAdjRoomDist=maxadjroomdist,
    outside=deconstruct_brep.Vertices,
    structuralWalls=structural_walls,
    infillWalls=infill_walls,
    publics=public_circulation,
    toilets=wet_cells,
    storages=storages,
    livings=living_rooms,
    kitchens=kitchen,
    hallways=hallways,
    bedrooms=bedrooms,
    others=others)  # -> out, nodes, edges; inputs lineStep: Double, errorMargin: Double, maxAdjRoomDist: Double, outside: list of Point3d, structuralWalls: list of Brep, infillWalls: list of Brep, publics: list of Brep, toilets: list of Brep, storages: list of Brep, livings: list of Brep, kitchens: list of Brep, hallways: list of Brep, bedrooms: list of Brep, others: list of Brep
# ---------- c_script: C# ----------
    Point2d boundMin = new Point2d(outside[0]);
    Point2d boundMax = new Point2d(outside[2]);

    SceneEntities sceneEntities = new SceneEntities();
    //Add rooms first
    sceneEntities.AddRoomsFromBreps(publics, "public");
    sceneEntities.AddRoomsFromBreps(toilets, "toilet");
    sceneEntities.AddRoomsFromBreps(storages, "storage");
    sceneEntities.AddRoomsFromBreps(livings, "living");
    sceneEntities.AddRoomsFromBreps(kitchens, "kitchen");
    sceneEntities.AddRoomsFromBreps(hallways, "hallway");
    sceneEntities.AddRoomsFromBreps(bedrooms, "bedroom");
    sceneEntities.AddRoomsFromBreps(others, "others");
    //Add walls last
    sceneEntities.AddWallFromBreps(structuralWalls, "structural");
    sceneEntities.AddWallFromBreps(infillWalls, "infill");

    //vertical scan of entities using raytracing
    Print("printing debug\n");
    for (double y = boundMin.Y; y < boundMax.Y; y += _lineStep){
      //sceneEntities.Edges.Clear();  //debug
      //Print("Line " + y.ToString() + "\n");
      Dictionary<int,List<double>> scannedRay = new Dictionary<int,List<double>>();  //<globalEntityId, sortedIntersectionPoints>
      VerticalScan(y, scannedRay, sceneEntities.Entities, _errorMargin);

      if (scannedRay.Count == 0) continue;

      // <Parse and detect edges and adjacency>
      sceneEntities.BuildNodesAndEdges(scannedRay, _maxAdjRoomDist);
    }

    for (double x = boundMin.X; x < boundMax.X; x += _lineStep){
      //sceneEntities.Edges.Clear();  //debug
      //Print("Line " + x.ToString() + "\n");
      Dictionary<int,List<double>> scannedRay = new Dictionary<int,List<double>>();  //<globalEntityId, sortedIntersectionPoints>
      HorizontalScan(x, scannedRay, sceneEntities.Entities, _errorMargin);

      if (scannedRay.Count == 0) continue;

      // <Parse and detect edges and adjacency>
      sceneEntities.BuildNodesAndEdges(scannedRay, _maxAdjRoomDist);
      //Print(sceneEntities.ToString());
    }
    Print(sceneEntities.ToString());
    edges = sceneEntities.DumpEdgesToLines();
# ---------- c_script: C# additional code ----------
  //----------------------------Utility functions--------------------------------
  //Checks intersection with horizontal rays from down to upwards
  private static void VerticalScan(double y, Dictionary<int,List<double>> scannedRay, List<Entity> entities, double errorMargin){
    for (int i = 0; i < entities.Count; i++){
      //paths are drawn from bottom left corner then clockwise-
      int lastPointIndex = entities[i].Vertices.Count - 1;
      for (int j = 0; j < entities[i].Vertices.Count;j++){
        Point2d ptA = new Point2d(entities[i].Vertices[j].Location);
        Point2d ptB;
        if (j == lastPointIndex){
          ptB = new Point2d(entities[i].Vertices[0].Location);
        }
        else{
          ptB = new Point2d(entities[i].Vertices[j + 1].Location);
        }

        double dx = ptB.X - ptA.X;
        double dy = ptB.Y - ptA.Y;

        //ignoring parallel lines
        if (dy != 0){
          double difA = y - ptA.Y;
          double difB = y - ptB.Y;
          //check bounds
          if ((y < ptA.Y && y < ptB.Y) || (y > ptA.Y && y > ptB.Y)){
            continue;
          }
          else{
            double x = (dy == 0) ? ptA.X : (y - ptA.Y) / (dy / dx) + ptA.X;
            if (scannedRay.ContainsKey(i))
              AddSorted(scannedRay[i], x);
            else
              scannedRay.Add(i, new List<double>(){x});
          }
        }
      }
    }
  }

  //Checks intersection with vertical rays from left to right
  private static void HorizontalScan(double x, Dictionary<int,List<double>> scannedRay, List<Entity> entities, double errorMargin){
    for (int i = 0; i < entities.Count; i++){
      //paths are drawn from bottom left corner then clockwise-
      int lastPointIndex = entities[i].Vertices.Count - 1;
      for (int j = 0; j < entities[i].Vertices.Count;j++){
        Point2d ptA = new Point2d(entities[i].Vertices[j].Location);
        Point2d ptB;
        if (j == lastPointIndex){
          ptB = new Point2d(entities[i].Vertices[0].Location);
        }
        else{
          ptB = new Point2d(entities[i].Vertices[j + 1].Location);
        }

        double dx = ptB.X - ptA.X;
        double dy = ptB.Y - ptA.Y;

        //ignoring parallel lines
        if (dx != 0){
          double difA = x - ptA.X;
          double difB = x - ptB.X;
          //check bounds
          if ((x < ptA.X && x < ptB.X) || (x > ptA.X && x > ptB.X)){
            continue;
          }
          else{
            double y = (dx == 0) ? ptA.Y : (x - ptA.X) * (dy / dx) + ptA.Y;
            if (scannedRay.ContainsKey(i))
              AddSorted(scannedRay[i], y);
            else
              scannedRay.Add(i, new List<double>(){y});
          }
        }
      }
    }
  }

  private static void AddSorted(List<double> list, double value)
  {
    int x = list.BinarySearch(value);
    list.Insert((x >= 0) ? x : ~x, value);
  }

  private static List<KeyValuePair<int, List<double>>> SortScannedToList(Dictionary<int,List<double>> scannedRay, List<Entity> entities){
    List<KeyValuePair<int, List<double>>> sortedScanned = new List<KeyValuePair<int, List<double>>>(scannedRay);
    sortedScanned.Sort(
      delegate(KeyValuePair<int, List<double>> firstPair, KeyValuePair<int, List<double>> nextPair){
        int res = firstPair.Value[0].CompareTo(nextPair.Value[0]);
        /*if (res == 0){
          return (entities[firstPair.Key].EntityType() == "room") ? -1 : 1;
        }*/
        return res;
      });
    return sortedScanned;
  }

  //----------------------------Class definitions--------------------------------
  private class SceneEntities{
    public int Count { get; private set; }
    public List<Entity> Entities { get; private set; }
    public HashSet<int> Nodes { get; private set; }
    public Dictionary<String, HashSet<int>> Edges { get; set; }

    public SceneEntities(){
      Count = 0;  //used for setting local id. 0 is reserved for arbituary outside node
      Entities = new List<Entity>();
      Nodes = new HashSet<int>(){Count++};
      Edges = new Dictionary<String, HashSet<int>>();
    }
    public void AddRoomsFromBreps(List<Brep> breps, string type){
      for (int i = 0; i < breps.Count; i++){
        Nodes.Add(Count);
        Entities.Add(new Room(Count++, breps[i].Vertices, type, SceneEntities.GetCentroid(breps[i])));
      }
    }

    public void AddWallFromBreps(List<Brep> breps, string type){
      for (int i = 0; i < breps.Count; i++){
        Entities.Add(new Wall(Count++, breps[i].Vertices, type, SceneEntities.GetCentroid(breps[i])));
      }
    }

    public string BuildNodesAndEdges(Dictionary<int,List<double>> scannedRay, double _maxAdjRoomDist){
      List<KeyValuePair<int, List<double>>> sortedScanned = SortScannedToList(scannedRay, Entities);
      string res = "";
      foreach (KeyValuePair<int, List<double>> kvp in sortedScanned)
      {
        res += string.Format("Index = {0} {1}, Value = {2}\n", Entities[kvp.Key].Id, Entities[kvp.Key].EntityType() + " " + Entities[kvp.Key].Type, String.Join(", ", kvp.Value.ToArray()));
      }//Print Debug
      HashSet<int> infillWalIds = new HashSet<int>();
      int prevNodeId = 0;
      double[] prevNodeTs = new double[2] {0,0};  //{tStart, tEnd}
      double adjDist = 0;
      double tPrev = sortedScanned[0].Value[0];

      for (int i = 0;i < sortedScanned.Count;i++){
        int entityIndex = sortedScanned[i].Key;
        Entity entity = Entities[entityIndex];
        int entityId = entity.Id;
        double tStart = sortedScanned[i].Value[0];
        double tEnd = sortedScanned[i].Value[1];

        if (entity.EntityType() == "wall"){
          if (prevNodeId != 0){
            //ignore walls bounded in rooms for now (? to store in room node in future?)
            if (tStart >= prevNodeTs[0] && tStart <= prevNodeTs[1] && tEnd >= prevNodeTs[0] && tEnd <= prevNodeTs[1])
              continue;
          }
          adjDist += (tStart - tPrev) + (tEnd - tStart);
          if (adjDist > _maxAdjRoomDist){
            infillWalIds.Clear();
            adjDist = (tEnd - tStart);
            prevNodeId = 0;
          }
          if (entity.Type == "infill"){
            infillWalIds.Add(entityId);
          }
          else if (entity.Type == "structural"){
            prevNodeId = 0;
          }
          tPrev = tEnd;
        }
        else if (entity.EntityType() == "room"){
          adjDist += (tStart - tPrev);
          if (adjDist <= _maxAdjRoomDist && prevNodeId != 0){
            string edgeId = (prevNodeId < entityId) ? string.Format("{0}/{1}", prevNodeId, entityId) : string.Format("{1}/{0}", prevNodeId, entityId);
            if (Edges.ContainsKey(edgeId)){
              Edges[edgeId].UnionWith(infillWalIds);
            }
            else{
              Edges.Add(edgeId, infillWalIds);
            }
          }
          infillWalIds = new HashSet<int>();
          prevNodeId = entityId;
          prevNodeTs[0] = tStart;
          prevNodeTs[1] = tEnd;
          adjDist = 0;
          tPrev = tEnd;
        }
      }
      return res;
    }

    public static Point3d GetCentroid(Brep brep){
      return new Point3d(VolumeMassProperties.Compute(brep).Centroid);
    }

    public List<Line> DumpEdgesToLines(){
      List<Line> res = new List<Line>();
      string[] delimiter = new String[]{"/"};
      foreach (KeyValuePair<String, HashSet<int>> kvp in Edges)
      {
        string[] nodes = kvp.Key.Split(delimiter, 2, StringSplitOptions.RemoveEmptyEntries);
        //-1 to convert from id to index
        res.Add(new Line(Entities[Int32.Parse(nodes[0]) - 1].Centroid, Entities[Int32.Parse(nodes[1]) - 1].Centroid));
      }
      return res;
    }

    public string ExportNodesJson(){
      List<Node> nodes = new List<Node>();
      foreach (int nId in Nodes){
        nodes.Add(new Node(nId.ToString(), Entities[nId - 1].Type));
      }
      return "";
      //return System.Text.Json.JsonSerializer.Serialize(nodes);
    }

    public string ExportEdgesJson(){
      List<Edge> edges = new List<Edge>();
      string[] delimiter = new String[]{"/"};
      foreach (KeyValuePair<String, HashSet<int>> kvp in Edges)
      {
        string[] nodes = kvp.Key.Split(delimiter, 2, StringSplitOptions.RemoveEmptyEntries);
        if(Entities[Int32.Parse(nodes[0]) - 1].Type == "public" && Entities[Int32.Parse(nodes[1]) - 1].Type == "hallway")
          edges.Add(new Edge(kvp.Key, true, true));
        else
          edges.Add(new Edge(kvp.Key, true, true));
      }
      return "";
      //return System.Text.Json.JsonSerializer.Serialize(edges);
    }

    public override string ToString(){
      string res = "Nodes:\n";
      res += String.Join(", ", Nodes);
      res += "\nEdges:\n";
      foreach (KeyValuePair<String, HashSet<int>> kvp in Edges)
      {
        res += string.Format("{0}: {1}\n", kvp.Key, String.Join(", ", kvp.Value));
      }
      return res;
    }
  }

  private class Node{
    public string id;
    public string roomtype;
    public double floorArea = 0;

    public Node(string id, string roomtype){
      this.id = id;
      this.roomtype = roomtype;
    }
  }

  private class Edge{
    public string edgeId;
    public bool isAccessible;
    public bool isDoorway;

    public Edge(string edgeId, bool isAccessible, bool isDoorway){
      this.edgeId = edgeId;
      this.isAccessible = isAccessible;
      this.isDoorway = isDoorway;
    }
  }

  private class Entity{
    public int Id { get; private set; }
    public Rhino.Geometry.Collections.BrepVertexList Vertices { get; private set; }
    public Point3d Centroid { get; private set; }
    public virtual string EntityType() { return "entity"; }  //node or wall
    public string Type { get; private set; }  //roomtype or walltype depending on class

    public Entity(int id, Rhino.Geometry.Collections.BrepVertexList vertices, string type, Point3d centroid){
      Id = id;
      Vertices = vertices;
      Type = type;
      //Centroid = centroid;

      Point3d avg = new Point3d(0,0,0);
      for (int j = 0; j < Vertices.Count;j++){
        avg += Vertices[j].Location;
      }
      Centroid = avg / Vertices.Count;
    }
  }

  private class Room:Entity{
    public override string EntityType() { return "room"; }

    public Room(int id, Rhino.Geometry.Collections.BrepVertexList vertices, string type, Point3d centroid) : base(id, vertices, type, centroid){

    }
  }

  private class Wall:Entity{
    public override string EntityType() { return "wall"; }

    public Wall(int id, Rhino.Geometry.Collections.BrepVertexList vertices, string type, Point3d centroid) : base(id, vertices, type, centroid){

    }
  }
# ---------- end c_script ----------
line = Line(c_script.edges)
panel = Panel(c_script.out)
